# Grasshopper definition Accordion.gh (Grasshopper 1.0.7)

planesrf = PlaneSurface(Plane=PlaneXY(0, 0, 0), XSize=Slider(50, range=0..100), YSize=Slider(80, range=0..100))
debrep = DeconstructBrep(Brep=planesrf)  # -> Faces, Edges, Vertices
item = ListItem(List=debrep.Edges, Index=0, Wrap=True)  # -> Item, Item1, Item2, Item3
rotax = RotateAxis(Geometry=planesrf, Angle=degrees(Slider(47.9, range=0..90)), Axis=item.Item3)  # -> Geometry, Transform
debrep_2 = DeconstructBrep(Brep=rotax.Geometry)  # -> Faces, Edges, Vertices
item_2 = ListItem(List=debrep_2.Vertices, Index=0, Wrap=True)  # -> Item, Item1
number_slider = Slider(2, range=0..100)
pdecon = Deconstruct(Point=item_2.Item1)  # -> XComponent, YComponent, ZComponent
X = UnitX(Factor=expr("2*x", pdecon.XComponent))
yz = YZPlane(Origin=item_2.Item1)
arrlinear = LinearArray(Geometry=rotax.Geometry, Direction=X, Count=number_slider)  # -> Geometry, Transform
mirror = Mirror(Geometry=rotax.Geometry, Plane=yz)  # -> Geometry, Transform
arrlinear_2 = LinearArray(Geometry=mirror.Geometry, Direction=X, Count=number_slider)  # -> Geometry, Transform
swatch = ColourSwatch(SwatchColor=RGB(95, 121, 194))
preview = CustomPreview(Geometry=arrlinear.Geometry, Material=swatch)
preview_2 = CustomPreview(Geometry=arrlinear_2.Geometry, Material=swatch)
