# Grasshopper definition Cube.gh (Grasshopper 1.0.7)

planesrf = PlaneSurface(Plane=PlaneXY(0, 0, 0), XSize=Slider(50, range=0..100), YSize=Slider(50, range=0..100))
planesrf_2 = PlaneSurface(Plane=PlaneXY(0, 0, 0), XSize=Slider(50, range=0..100), YSize=Slider(50, range=0..100))
planesrf_3 = PlaneSurface(Plane=PlaneXY(0, 0, 0), XSize=Slider(50, range=0..100), YSize=Slider(50, range=0..100))
planesrf_4 = PlaneSurface(Plane=PlaneXY(0, 0, 0), XSize=Slider(50, range=0..100), YSize=Slider(50, range=0..100))
debrep = DeconstructBrep(Brep=planesrf)  # -> Faces, Edges, Vertices
debrep_2 = DeconstructBrep(Brep=planesrf_2)  # -> Faces, Edges, Vertices
debrep_3 = DeconstructBrep(Brep=planesrf_3)  # -> Faces, Edges, Vertices
debrep_4 = DeconstructBrep(Brep=planesrf_4)  # -> Faces, Edges, Vertices
num = Number(180)
number_slider = Slider(90, range=0..90)
subtraction = Subtraction(A=num, B=number_slider)
item = ListItem(List=debrep.Edges, Index=0, Wrap=True)  # -> Item, Item1, Item2, Item3
item_2 = ListItem(List=debrep_2.Edges, Index=0, Wrap=True)  # -> Item, Item1, Item2, Item3
item_3 = ListItem(List=debrep_3.Edges, Index=0, Wrap=True)  # -> Item, Item1, Item2, Item3
item_4 = ListItem(List=debrep_4.Edges, Index=0, Wrap=True)  # -> Item, Item1, Item2, Item3
rotax = RotateAxis(Geometry=planesrf, Angle=degrees(Slider(0, range=0..90)), Axis=item.Item3)  # -> Geometry, Transform
rotax_2 = RotateAxis(Geometry=planesrf_2, Angle=degrees(subtraction), Axis=item_2.Item)  # -> Geometry, Transform
rotax_3 = RotateAxis(Geometry=planesrf_3, Angle=degrees(number_slider), Axis=item_3.Item3)  # -> Geometry, Transform
rotax_4 = RotateAxis(Geometry=planesrf_4, Angle=degrees(number_slider), Axis=item_4.Item)  # -> Geometry, Transform
num_2 = Number(0)
num_3 = Number(-50)
num_4 = Number(0)
num_5 = Number(-50)
num_6 = Number(0)
num_7 = Number(0)
num_8 = Number(-50)
num_9 = Number(50)
num_10 = Number(0)
vec = VectorXYZ(XComponent=num_3, YComponent=num_4, ZComponent=num_2)  # -> Vector, Length
vec_2 = VectorXYZ(XComponent=num_5, YComponent=num_6, ZComponent=num_7)  # -> Vector, Length
vec_3 = VectorXYZ(XComponent=num_8, YComponent=num_9, ZComponent=num_10)  # -> Vector, Length
move = Move(Geometry=rotax.Geometry, Motion=vec.Vector)  # -> Geometry, Transform
move_2 = Move(Geometry=rotax_2.Geometry, Motion=vec_2.Vector)  # -> Geometry, Transform
move_3 = Move(Geometry=rotax_4.Geometry, Motion=vec_3.Vector)  # -> Geometry, Transform
planesrf_5 = PlaneSurface(Plane=PlaneXY(0, 0, 0), XSize=Slider(50, range=0..100), YSize=Slider(50, range=0..100))
debrep_5 = DeconstructBrep(Brep=planesrf_5)  # -> Faces, Edges, Vertices
item_5 = ListItem(List=debrep_5.Edges, Index=0, Wrap=True)  # -> Item, Item1, Item2, Item3
rotax_5 = RotateAxis(Geometry=planesrf_5, Angle=degrees(number_slider), Axis=item_5.Item1)  # -> Geometry, Transform
num_11 = Number(-100)
vec_4 = VectorXYZ(XComponent=num_11, YComponent=0, ZComponent=0)  # -> Vector, Length
move_4 = Move(Geometry=rotax_5.Geometry, Motion=vec_4.Vector)  # -> Geometry, Transform
swatch = ColourSwatch(SwatchColor=RGB(95, 121, 194))
preview = CustomPreview(Geometry=rotax_3.Geometry, Material=swatch)
preview_2 = CustomPreview(Geometry=move.Geometry, Material=swatch)
preview_3 = CustomPreview(Geometry=move_2.Geometry, Material=swatch)
preview_4 = CustomPreview(Geometry=move_3.Geometry, Material=swatch)
preview_5 = CustomPreview(Geometry=move_4.Geometry, Material=swatch)
