# Grasshopper definition Hex_cyl.gh (Grasshopper 1.0.7)

xy = XYPlane(Origin=Point(0, 0, 0))
planesrf = PlaneSurface(Plane=xy, XSize=Slider(50, range=0..100), YSize=Slider(25, range=0..100))
number_slider = Slider(0, range=0..60)
debrep = DeconstructBrep(Brep=planesrf)  # -> Faces, Edges, Vertices
num = Number(180)
subtraction = Subtraction(A=num, B=number_slider)
rotax = RotateAxis(Geometry=debrep.Faces, Angle=degrees(subtraction), Axis=Line((0, 0, 0), (10, 0, 0)))  # -> Geometry, Transform
num_2 = Number(180)
addition = Addition(A=num, B=number_slider)
debrep_2 = DeconstructBrep(Brep=rotax.Geometry)  # -> Faces, Edges, Vertices
subtraction_2 = Subtraction(A=num_2, B=number_slider)
item = ListItem(List=debrep_2.Edges, Index=0, Wrap=True)  # -> Item, Item1, Item2
num_3 = Number(180)
addition_2 = Addition(A=num_3, B=number_slider)
rotax_2 = RotateAxis(Geometry=debrep_2.Faces, Angle=degrees(addition), Axis=item.Item2)  # -> Geometry, Transform
num_4 = Number(180)
debrep_3 = DeconstructBrep(Brep=rotax_2.Geometry)  # -> Faces, Edges, Vertices
subtraction_3 = Subtraction(A=num_4, B=number_slider)
item_2 = ListItem(List=debrep_3.Edges, Index=0, Wrap=True)
rotax_3 = RotateAxis(Geometry=debrep_3.Faces, Angle=degrees(subtraction_2), Axis=item_2)  # -> Geometry, Transform
debrep_4 = DeconstructBrep(Brep=rotax_3.Geometry)  # -> Faces, Edges, Vertices
item_3 = ListItem(List=debrep_4.Edges, Index=0, Wrap=True)  # -> Item, Item1, Item2
rotax_4 = RotateAxis(Geometry=debrep_4.Faces, Angle=degrees(addition_2), Axis=item_3.Item2)  # -> Geometry, Transform
debrep_5 = DeconstructBrep(Brep=rotax_4.Geometry)  # -> Faces, Edges, Vertices
item_4 = ListItem(List=debrep_5.Edges, Index=0, Wrap=True)
rotax_5 = RotateAxis(Geometry=debrep_5.Faces, Angle=degrees(subtraction_3), Axis=item_4)  # -> Geometry, Transform
swatch = ColourSwatch(SwatchColor=RGB(95, 121, 194))
preview = CustomPreview(Geometry=planesrf, Material=swatch)
preview_2 = CustomPreview(Geometry=rotax.Geometry, Material=swatch)
preview_3 = CustomPreview(Geometry=rotax_2.Geometry, Material=swatch)
preview_4 = CustomPreview(Geometry=rotax_3.Geometry, Material=swatch)
preview_5 = CustomPreview(Geometry=rotax_4.Geometry, Material=swatch)
preview_6 = CustomPreview(Geometry=rotax_5.Geometry, Material=swatch)
