# Grasshopper definition Triangle.gh (Grasshopper 1.0.7)

srf = Surface(<surface referenced from the Rhino model>)
debrep = DeconstructBrep(Brep=srf)  # -> Faces, Edges, Vertices
number_slider = Slider(180, range=180..289)
item = ListItem(List=debrep.Edges, Index=0, Wrap=True)  # -> Item, Item1, Item2
rotax = RotateAxis(Geometry=debrep.Faces, Angle=degrees(number_slider), Axis=item.Item)  # -> Geometry, Transform
rotax_2 = RotateAxis(Geometry=debrep.Faces, Angle=degrees(number_slider), Axis=item.Item2)  # -> Geometry, Transform
rotax_3 = RotateAxis(Geometry=debrep.Faces, Angle=degrees(number_slider), Axis=item.Item1)  # -> Geometry, Transform
swatch = ColourSwatch(SwatchColor=RGB(95, 121, 194))
preview = CustomPreview(Geometry=rotax.Geometry, Material=swatch)
preview_2 = CustomPreview(Geometry=rotax_2.Geometry, Material=swatch)
preview_3 = CustomPreview(Geometry=srf, Material=swatch)
preview_4 = CustomPreview(Geometry=rotax_3.Geometry, Material=swatch)
